# Dynamo graph Creating of Levels and Floor Plans.dyn (Dynamo 2.19.3.6394)

# group: Basements
# Nodes for creation levels for basements
enter_no_of_basements = IntegerSlider(4, range=0..4 step 1)  # graph input
height_of_basement_in_meters = IntegerSlider(4, range=0..4 step 1)  # graph input
code_block = CodeBlock(Basements=enter_no_of_basements, height=height_of_basement_in_meters) { 0..#Basements..height; }
code_block_2 = CodeBlock(basements=enter_no_of_basements) { 1..#basements..1; }
code_block_3 = CodeBlock(mumber=code_block_2) { "Basement "+mumber; }
byElevationAndName = Level.ByElevationAndName(elevation=code_block, name=code_block_3)

# group: Floor plan creation for Basements
do_you_want_to_create_floor_plan = BoolSelector(true)  # "Do you want to create floor plan for basements ?"; graph input
code_block_4 = CodeBlock(x=byElevationAndName) { x; }
floor_creation_for_basements = FloorPlanView.ByLevel(level=code_block_4)
if_ = RefactoredIf(test=do_you_want_to_create_floor_plan, true=floor_creation_for_basements)  # unwired: false
code_block_5 = CodeBlock { "View Name"; }

# group: Creation of Levels
# Nodes are required for the creation of levels
lastItem = List.LastItem(list=code_block)
height_for_level_in_meters = IntegerSlider(4, range=1..4 step 1)  # graph input
code_block_6 = CodeBlock(Basementheight=lastItem, levelheight=height_for_level_in_meters) { Basementheight+levelheight; }
enter_no_of_levels = IntegerSlider(10, range=1..25 step 1)  # graph input
code_block_7 = CodeBlock(Startpoint=code_block_6, Levels=enter_no_of_levels, height=height_for_level_in_meters) { Startpoint..#Levels..height; }
code_block_8 = CodeBlock(Levels=enter_no_of_levels) { 1..#Levels..1; }
code_block_9 = CodeBlock(number=code_block_8) { "Level "+ number; }
byElevationAndName_2 = Level.ByElevationAndName(elevation=code_block_7, name=code_block_9)

# group: Floor plan creation for levels
code_block_10 = CodeBlock { "View Name"; }
do_you_want_to_create_floor_plan_2 = BoolSelector(true)  # "Do you want to create floor plan for Levels ?"; graph input
code_block_11 = CodeBlock(x=byElevationAndName_2) { x; }
floor_creation_for_levels = FloorPlanView.ByLevel(level=code_block_11)
if_2 = RefactoredIf(test=do_you_want_to_create_floor_plan_2, true=floor_creation_for_levels)  # unwired: false
