# Dynamo graph Duplicating Grids.dyn (Dynamo 2.19.3.6394)
# packages: Genius Loci 2023.2.21

code_block = CodeBlock { true; }
# note: GeniusLoci
select_linked_element = Custom[Select Linked Element](refresh=code_block)  # package Genius Loci; Selects the linked elements.
curve = Grid.Curve(grid=select_linked_element.Element)
startPoint = Curve.StartPoint(curve=curve)
endPoint = Curve.EndPoint(curve=curve)
byStartPointEndPoint = Grid.ByStartPointEndPoint(start=startPoint, end=endPoint)
code_block_2 = CodeBlock { "Name"; }
code_block_3 = CodeBlock { "Name"; }
getParameterValueByName = Element.GetParameterValueByName(element=select_linked_element.Element, parameterName=code_block_3)
setParameterByName = Element.SetParameterByName(element=byStartPointEndPoint, parameterName=code_block_2, value=getParameterValueByName)
