# Dynamo graph Sheets Creation.dyn (Dynamo 3.3.0.6316)
# packages: Genius Loci 2023.2.21, Rhythm 2022.7.2

file_path = Filename(".\Sheet Names.xlsx")
file_from_path = FileObject(path=file_path)
enter_the_sheet_name = StringInput("Sheet1")
code_block = CodeBlock { true; }
code_block_2 = CodeBlock { false; }
importExcel = Data.ImportExcel(file=file_from_path, sheetName=enter_the_sheet_name, readAsStrings=code_block, showExcel=code_block_2)
restOfItems = List.RestOfItems(list=importExcel)
transpose = List.Transpose(lists=restOfItems)
code_block_3 = CodeBlock(x=transpose) { x[1]; }
code_block_4 = CodeBlock(x=transpose) { x[0]; }
# note: Rhythm
titleblock_types = TagTypes("Title_Blocks_A1_Metric:Standard")
# note: Genius Loci
create_sheet = Custom[Create Sheet](sheetName=code_block_3, sheetNumber=code_block_4, titleBlock=titleblock_types)  # package Genius Loci; Creates new sheets.
