# Dynamo graph EXPORTER.dyn (Dynamo 2.16.4.10216)
# packages: Crumple 2024.4.3, Data-Shapes 2025.3.119

# group: Sheet selection
code_block = CodeBlock { "Select the sheets"; }
current = Document.Current()
collect_sheets = Custom[© Collect.Sheets](docOrLink=current)  # package Crumple; Returns all the sheets in a document, with the option to omit any placeholder sheets.
code_block_2 = CodeBlock { 300; }
code_block_3 = CodeBlock { false; }
listview_data = Custom[Listview Data](InputName=code_block, Keys=collect_sheets, Values=collect_sheets, Height_optionnal=code_block_2, ShowId_optionnal=code_block_3)  # package Data-Shapes; Create data for ListView input in UI.MultiInputForm ++ . Check out www.data-shapes.net for more infos.

# group: Select the path
code_block_4 = CodeBlock { "Select the Path"; "Browse path"; }
directorypath_data = Custom[DirectoryPath Data](InputName=code_block_4.out0, ButtonText=code_block_4.out1)  # package Data-Shapes; Creates a DirectoryPath input for UI.MultipleInputForm ++ . Check out www.data-shapes.net for more infos!

# group: PDF Export Option
string = StringInput("PDF EXPORTs")
boolean = BoolSelector(false)
boolean_input = Custom[Boolean input](InputName=string, DefaultValue=boolean)  # package Data-Shapes; Creates a boolean input for UI.MultipleInputForm ++ . Check out www.data-shapes.net for more infos!

# group: DWG Export Option
string_2 = StringInput("CAD EXPORT")
boolean_input_2 = Custom[Boolean input](InputName=string_2)

# group: UI
code_block_5 = CodeBlock { "SHEETS EXPORTER"; }
code_block_6 = CodeBlock { "Click to Export"; }
list_create = List.Create(item0=listview_data, item1=directorypath_data, item2=boolean_input, item3=boolean_input_2)
code_block_7 = CodeBlock { true; }
code_block_8 = CodeBlock { "Cancel"; }
code_block_9 = CodeBlock { 900; }
code_block_10 = CodeBlock { 200; }
multipleinputform = Custom[MultipleInputForm ++](Description_optional=code_block_5, ButtonText_optional=code_block_6, Inputs=list_create, Toggle=code_block_7, CancelButtonText_optional=code_block_8, Width_optional=code_block_9, LabelWidth_optional=code_block_10)  # package Data-Shapes; Create a form with multiple inputs. see www.data-shapes.net for tutorials and infos!

code_block_11 = CodeBlock(x=multipleinputform.User_Inputs) { x[1]; }
code_block_12 = CodeBlock(x=multipleinputform.User_Inputs) { x[0]; }
flatten = List.Flatten(list=code_block_12)
sheetName = Sheet.SheetName(sheet=code_block_12)
flatten_2 = List.Flatten(list=sheetName)
code_block_13 = CodeBlock(x=multipleinputform.User_Inputs) { x[2]; }

# group: PDF Export
code_block_14 = CodeBlock { [true, true, true, true, true]; }
code_block_15 = CodeBlock { [false, false, false, false, false]; }
if_ = RefactoredIf(test=code_block_13, true=code_block_14, false=code_block_15)
revit_exporttopdf = Custom[© Revit.ExportToPdf](directoryPath=code_block_11, sheets=flatten, fileNames=flatten_2, options=if_)  # package Crumple; Given a list of sheets, names, directory and export options this node will batch export PDF files. Requires Revit 2022 or higher to work.

code_block_16 = CodeBlock(x=multipleinputform.User_Inputs) { x[3]; }

# group: DWG Export
code_block_17 = CodeBlock { "DWG Exports"; }
code_block_18 = CodeBlock { true; }
revit_exportoptionsdwg = Custom[© Revit.ExportOptionsDwg](settingsName=code_block_17, useSharedCoordinates=code_block_18, mergeViewsAsXrefs=code_block_18)  # package Crumple; Creates a DWG export options object, or retrieves one with the given name if found in the document.
revit_exporttodwg = Custom[© Revit.ExportToDwg](directoryPath=code_block_11, viewsOrSheets=flatten, fileNames=flatten_2, dwgExportOptions=revit_exportoptionsdwg.dwgExportOptions, runMe=code_block_16)  # package Crumple; Given a list of views and/or sheets as well as various related settings, attempts to export them to DWG using the provided settings.
