# Dynamo graph Save Multiple Families.dyn "SMF" (Dynamo 2.16.4.10216)
# packages: Data-Shapes 2025.3.119, Crumple 2024.4.3

code_block = CodeBlock { "Families are saved"; }
code_block_2 = CodeBlock { "Task completed"; }
current = Document.Current()
code_block_3 = CodeBlock { "Save Multiple Families"; }
code_block_4 = CodeBlock { "Continue"; }
code_block_5 = CodeBlock { "Select Families"; }
python_script = Python()  # CPython3; unwired: IN[0]
# ---------- python_script.python (18 lines) ----------
import clr
clr.AddReference('RevitServices')
from RevitServices.Persistence import DocumentManager
from RevitServices.Transactions import TransactionManager

clr.AddReference('RevitAPI')
from Autodesk.Revit.DB import FilteredElementCollector, Family

doc = DocumentManager.Instance.CurrentDBDocument

# Collect all families in the project
families = FilteredElementCollector(doc).OfClass(Family).ToElements()

# Get family names
family_names = [f.Name for f in families]

# Output the list of family names
OUT = family_names
# ----------------------------------------
code_block_6 = CodeBlock { 700; }
listview_data = Custom[Listview Data](InputName=code_block_5, Keys=python_script, Values=python_script, Height_optionnal=code_block_6)  # package Data-Shapes; Create data for ListView input in UI.MultiInputForm ++ . Check out www.data-shapes.net for more infos.
boolean = BoolSelector(true)
code_block_7 = CodeBlock { "Cancel"; }
code_block_8 = CodeBlock { 900; }
code_block_9 = CodeBlock { 250; }
multipleinputform = Custom[MultipleInputForm ++](Description_optional=code_block_3, ButtonText_optional=code_block_4, Inputs=listview_data, Toggle=boolean, CancelButtonText_optional=code_block_7, MaxHeight_optional=code_block_8, Width_optional=code_block_8, LabelWidth_optional=code_block_9)  # package Data-Shapes; Create a form with multiple inputs. see www.data-shapes.net for tutorials and infos!
byName = Family.ByName(name=multipleinputform.User_Inputs)
directory_path = Directory("No file selected.")
saveFamilyToFolder = Document.SaveFamilyToFolder(document=current, family=byName, directoryPath=directory_path)
ui_messenger = Custom[© UI.Messenger](title=code_block, body=code_block_2, pass=saveFamilyToFolder)  # package Crumple; Displays a message box with a title/body and OK/cancel button. If OK is selected, the third input's data will be passed through.
